# Dynamo graph Home.dyn (Dynamo 2.0.2.6826)

dimension_del_panel = DoubleSlider(4.7, range=0.1..10 step 0.1)
angulo_del_giro = DoubleSlider(45, range=0..90 step 1)

# group: MODULO
code_block = CodeBlock { 0..5; }
ORIGEN = CodeBlock { 0; }
code_block_2 = CodeBlock(x=dimension_del_panel, y1=ORIGEN, z=dimension_del_panel, x1=ORIGEN, z1=ORIGEN, a=dimension_del_panel)
# ---------- code_block_2.designscript (6 lines) ----------
Point.ByCoordinates(x,y1,z);
Point.ByCoordinates(x1,y1,z1);
Point.ByCoordinates(x,y1,z1);
Point.ByCoordinates(x1,y1,z);
true;
a/15;
# ----------------------------------------
list_create = List.Create(item0=code_block_2.out0, item1=code_block_2.out2, item2=code_block_2.out1, item3=code_block_2.out3)
borde_del_panel = PolyCurve.ByPoints(points=list_create, connectLastToFirst=code_block_2.out4)
cara_del_panel = Curve.Patch(curve=borde_del_panel)
volumen_panel = Surface.Thicken(surface=cara_del_panel, thickness=code_block_2.out5)
code_block_3 = CodeBlock { 1; }
code_block_4 = CodeBlock(l=code_block_3) { 0..l..1; }
code_block_5 = CodeBlock(n=code_block_4) { (2*n+1); 2*n; }
code_block_6 = CodeBlock(l=dimension_del_panel, x=code_block_5.out0) { l*x; }
translate = Geometry.Translate(geometry=volumen_panel, zTranslation=code_block_6)
code_block_7 = CodeBlock { 0; 1; }
getItemAtIndex = List.GetItemAtIndex(list=translate, index=code_block_7.out0)
code_block_8 = CodeBlock(l=dimension_del_panel) { l*0.5; l*2; }
code_block_9 = CodeBlock { 0; }
punto_base = CodeBlock(x=code_block_8.out0, y=code_block_9, z=code_block_8.out1)
# ---------- punto_base.designscript (8 lines) ----------
Point.ByCoordinates(x,y,z);
//inferior centra;
Point.ByCoordinates(x,y,1.5*z);
 //superior central;
Point.ByCoordinates(x,y,1.25*z);
 // punto central;
 Point.ByCoordinates(x*2,y,1.25*z);
 // punto central;
# ----------------------------------------
byThreePoints = Circle.ByThreePoints(p1=punto_base.out0, p2=punto_base.out1, p3=punto_base.out3)
code_block_10 = CodeBlock { 0.25; 0; 0.5; 0.75; }
list_create_2 = List.Create(item0=code_block_10.out0, item1=code_block_10.out1, item2=code_block_10.out2, item3=code_block_10.out3)
pointAtParameter = Curve.PointAtParameter(curve=byThreePoints, param=list_create_2)
code_block_11 = CodeBlock { 0; 3; 1; 2; }
getItemAtIndex_2 = List.GetItemAtIndex(list=pointAtParameter, index=code_block_11.out2)
YAxis = Vector.YAxis()
rotate = Geometry.Rotate(geometry=getItemAtIndex, origin=getItemAtIndex_2, axis=YAxis, degrees=angulo_del_giro)
getItemAtIndex_3 = List.GetItemAtIndex(list=translate, index=code_block_7.out1)
getItemAtIndex_4 = List.GetItemAtIndex(list=pointAtParameter, index=code_block_11.out3)
YAxis_2 = Vector.YAxis()
rotate_2 = Geometry.Rotate(geometry=getItemAtIndex_3, origin=getItemAtIndex_4, axis=YAxis_2, degrees=angulo_del_giro)
code_block_12 = CodeBlock(l=dimension_del_panel, x=code_block_5.out1) { (l*x)-l; }
code_block_13 = CodeBlock(l=dimension_del_panel) { 2*l; }
translate_2 = Geometry.Translate(geometry=volumen_panel, xTranslation=code_block_12, zTranslation=code_block_13)
getItemAtIndex_5 = List.GetItemAtIndex(list=translate_2, index=code_block_7.out0)
getItemAtIndex_6 = List.GetItemAtIndex(list=pointAtParameter, index=code_block_11.out0)
rotate_3 = Geometry.Rotate(geometry=getItemAtIndex_5, origin=getItemAtIndex_6, axis=YAxis, degrees=angulo_del_giro)
getItemAtIndex_7 = List.GetItemAtIndex(list=translate_2, index=code_block_7.out1)
getItemAtIndex_8 = List.GetItemAtIndex(list=pointAtParameter, index=code_block_11.out1)
YAxis_3 = Vector.YAxis()
rotate_4 = Geometry.Rotate(geometry=getItemAtIndex_7, origin=getItemAtIndex_8, axis=YAxis_3, degrees=angulo_del_giro)
list_create_3 = List.Create(item0=rotate, item1=rotate_2, item2=rotate_3, item3=rotate_4)
code_block_14 = CodeBlock(x=angulo_del_giro, l=dimension_del_panel)
# ---------- code_block_14.designscript (9 lines) ----------
x*l/90;


/*
ecuacion lineal x-x0/y-y0=x1-x0/y1-y0

de donde x-0/y-0 = l-0/90-0
entonces x= y*l/90
*/;
# ----------------------------------------
code_block_15 = CodeBlock(x=dimension_del_panel, y=code_block_14) { x*4-2*y; }

translate_3 = Geometry.Translate(geometry=list_create_3, zTranslation=code_block_15)
code_block_16 = CodeBlock(x=dimension_del_panel) { 2*x; }
translate_4 = Geometry.Translate(geometry=list_create_3, xTranslation=code_block_15, zTranslation=code_block_16)
code_block_17 = CodeBlock(x=code_block_15) { x*-1; }
translate_5 = Geometry.Translate(geometry=list_create_3, xTranslation=code_block_17, zTranslation=code_block_16)
list_create_4 = List.Create(item0=translate_3, item1=translate_4, item2=translate_5, item3=list_create_3)
file_path = Filename("..\..\..\..\..\Desktop\c.sat")
exportToSAT = Geometry.ExportToSAT(geometry=list_create_4, filePath=file_path)
