# Dynamo graph RECTANGULO_DYNAMO.dyn (Dynamo 2.0.2.6826)

# group: PARAMETROS
ESCALA = DoubleSlider(0.25, range=0..2 step 0.01)
lados_del_poligon = IntegerSlider(4, range=3..19 step 1)
U = IntegerSlider(5, range=0..12 step 1)
ROTAR = DoubleSlider(90, range=0..180 step 0.1)
desfase = DoubleSlider(45, range=0..180 step 0.1)

# group: FCH
YZ = Plane.YZ()
code_block = CodeBlock { 5; }
byWidthLength = Rectangle.ByWidthLength(plane=YZ, width=code_block, length=code_block)

script_python = Python(IN[0]=ESCALA, IN[1]=lados_del_poligon, IN[2]=U, IN[3]=byWidthLength, IN[4]=ROTAR, IN[5]=desfase)
# ---------- script_python.python (77 lines) ----------
# Enable Python support and load DesignScript library
import clr
clr.AddReference('ProtoGeometry')
from Autodesk.DesignScript.Geometry import *
from math import *
"""
ENTRADA DE 
COORDENADAS CENTER POINT
"""

inRadio = IN[0] 
circulo= Circle.ByPlaneRadius(Plane.YZ(), inRadio)


vertices= []
i=0
j = 0
lados= IN[1]
while (i<=lados):
	vertice = circulo.PointAtParameter(j)
	vertices.append(vertice)
	j = j + 1.000/(1.000*lados)
	i = i+1
policurva = PolyCurve.ByPoints(vertices)

panel = Surface.ByPatch(policurva)

v= Vector.ByTwoPoints(vertices[0], vertices[1]) 
longitud= v.Length

n = IN[2]
"""
AQUI VA LA FACHADA
"""
rectangulo = IN[3]
fachada = Surface.ByPatch(rectangulo)
uvY=[]
uvZ=[]
horizontales=[]
d = 1.000 / n
contador = d
for y in range(1, n):
	uvY.append(fachada.PointAtParameter(0,contador))
	uvZ.append(fachada.PointAtParameter(contador,0))
	
	contador = d + contador
	y= y+1
UV=[]
for x in uvY:
	UV.append(x.Y)
puntosUV=[]
for x in UV:
	for y in UV:
		puntosUV.append(Point.ByCoordinates(0,x,y))
		

"""
Aqui transladamos los paneles
"""
p=[]
for x in puntosUV:
		p.append(panel.Thicken(0.1).Translate(0, x.Y, x.Z/2))

salida1=[]
salida2=[]
rotacion1= IN[4]
rotacion2= 180/lados+IN[5]
delta = Line.ByStartPointEndPoint(uvY[0],uvY[1]).Length
#punto vector grado
for x in p:
	for y in range(0,puntosUV.Count):
		if((y)%2==0 and y<n):
			salida1.append(x.Rotate(x.Centroid(),Vector.XAxis(),rotacion1))
		else:	
			salida2.append(x.Rotate(x.Centroid(),Vector.XAxis(),rotacion2).Translate(0,delta/2,delta/2))
#OUTPUTS
OUT =  [salida1, salida2,puntosUV]
# ----------------------------------------
